# Grasshopper definition hex graph with hops.gh (Grasshopper 1.0.7)
# plug-ins: Hops

hops = Hops(
    _Path="http://127.0.0.1:5000/createHexGraph",
    XDirectionNodes=Slider(5, range=0..10),
    YDirectionNodes=Slider(5, range=0..10),
    Layout=Slider(0, range=0..100),
    CacheResultsInMemory=True,
    CacheSolveResults=True,
    RemoteDefinitionLocation="http://127.0.0.1:5000/createHexGraph",
    RemoteSolveVersion=(0, 1, 0),
    ShowInput_Enabled=False,
    ShowInput_Path=True,
    SynchronousSolve=True)  # -> Nodes, Edges
