# Grasshopper definition pathGraph.gh (Grasshopper 1.0.7)
# plug-ins: Pufferfish, EleFront, Hops

rectangle = Rectangle(Plane=PlaneXY(0, 0, 0), XSize=Slider(18000, range=0..100000), YSize=Slider(32000, range=0..100000), Radius=0)  # -> Rectangle, Length
pop3d = Populate3D(Region=rectangle.Rectangle, Count=Slider(6, range=0..10), Seed=1)
srf = Surface(rectangle.Rectangle)
nurbs = NurbsCurve(Vertices=pop3d, Degree=3, Periodic=False)  # -> Curve, Length, Domain
popgeo = PopulateGeometry(Geometry=srf, Count=Slider(200, range=0..1000), Seed=1)
offcrv = OffsetCurve(Curve=nurbs.Curve, Plane=PlaneXY(0, 0, 0), Distance=Slider(500, range=0..1000), BothSides=True, Kinks=0, CapType=1)  # -> flatten(Offset)
path_crv = EFDataDescription(offcrv)
srf_2 = Surface(offcrv)
popgeo_2 = PopulateGeometry(Geometry=srf_2, Count=Slider(737, range=0..1000), Seed=1)
path_crv_2 = EFDataDescription(path_crv)
path_points = EFDataDescription(popgeo_2)
all_points = EFDataDescription(flatten([path_points, popgeo]))
voronoi = Voronoi(Points=all_points, Boundary=srf, BruteForceOverride=False)
incurve = PointInCurve(Point=all_points, Curve=path_crv_2)  # -> Relationship, Point
fillet = Fillet(Curve=voronoi, Radius=Slider(1000, range=0..1000))
dispatch = Dispatch(List=fillet, DispatchPattern=incurve.Relationship)  # -> ListA, ListB
path = Curve(dispatch.ListA)
custom_preview = CustomPreview(Geometry=path, Material=ColourSwatch(SwatchColor=RGB(0, 0, 0)))
area = Area(Geometry=path)  # -> Area, flatten(Centroid)
polyline = PolyLine(Vertices=area.Centroid, Closed=False)
explode = Explode(Curve=polyline, Recursive=True)  # -> Segments, Vertices

# ---- group: points
point = Point(area.Centroid)

# ---- group: curves
curve = Curve(explode.Segments)

# ----
hops = Hops(
    _Path="http://127.0.0.1:5000/pathGraphNetwork",
    CacheResultsInMemory=True,
    CacheSolveResults=True,
    RemoteDefinitionLocation="http://127.0.0.1:5000/pathGraphNetwork",
    RemoteSolveVersion=(0, 1, 0),
    ShowInput_Enabled=False,
    ShowInput_Path=True,
    SynchronousSolve=True)
