# Grasshopper definition tree path maker with hops.gh (Grasshopper 1.0.7)
# plug-ins: Hops

point = Point(Point(99.22946329, -0.202700185, 0))
point_2 = Point(Point(-121.6845097, 36.73939789, 0))
point_3 = Point(Point(-6.753231755, 82.60201561, 0))
hops = Hops(
    _Path="http://127.0.0.1:5000/createTreeLine",
    Point1=point,
    Point2=point_3,
    Point3=point_2,
    Height=Slider(15, range=0..100),
    TreeNumber=Slider(20, range=0..100),
    CanopySize=Slider(5, range=0..10),
    CacheResultsInMemory=True,
    CacheSolveResults=True,
    RemoteDefinitionLocation="http://127.0.0.1:5000/createTreeLine",
    RemoteSolveVersion=(0, 1, 0),
    ShowInput_Enabled=False,
    ShowInput_Path=True,
    SynchronousSolve=True)  # -> PathCurve, TreeTrunk, TreeCanopy
